# Grasshopper definition bimsc24_datamgmt_naree_assignment01.gh (Grasshopper 1.0.7)

height = GetInteger(Slider(3, range=0..100), AtLeast=1, AtMost=1, Maximum=2147483647, Minimum=-2147483648, TreeAccess=False)
spacing_between_floor = GetNumber(Slider(0.5, range=0..1), AtLeast=1, AtMost=1, Maximum=1.797693135e+308, Minimum=-1.797693135e+308, TreeAccess=False)
curve = Curve(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)
addition = Addition(A=height, B=spacing_between_floor)
surface = Surface(curve)
unit_z = UnitZ(Factor=height)
number_slider = Slider(20, range=0..100)
extrude = Extrude(Base=surface, Direction=unit_z)
unit_z_2 = UnitZ(Factor=addition)
angle = GetInteger(Slider(120, range=0..1000), AtLeast=1, AtMost=1, Maximum=2147483647, Minimum=-2147483648, TreeAccess=False)
no_of_floors = GetInteger(Slider(200, range=0..1000), AtLeast=1, AtMost=1, Maximum=200, Minimum=-2147483648, TreeAccess=False)
linear_array = LinearArray(Geometry=extrude, Direction=unit_z_2, Count=no_of_floors)  # -> Geometry, Transform
construct_domain = ConstructDomain(DomainStart=0, DomainEnd=angle)
volume = Volume(Geometry=linear_array.Geometry)  # -> Volume, Centroid
unit_z_3 = UnitZ(Factor=1)
range = Range(Domain=construct_domain, Steps=expr("x-1", no_of_floors))
rotate_3d = Rotate3D(Geometry=linear_array.Geometry, Angle=range, Center=volume.Centroid, Axis=unit_z_3)  # -> Geometry, Transform
geometry = Geometry(rotate_3d.Geometry)
context_bake = ContextBake(Geometry=geometry)
