# Grasshopper definition bimsc24_datamgmt_naree_assignment01_hops.gh (Grasshopper 1.0.7)
# plug-ins: Hops

panel = Panel("https://github.com/nareeiaac/bimsc24_datamgmt_assgn01/raw/main/bimsc24_datamgmt_naree_assignment01.gh")
number_slider = Slider(98, range=0..200)
hops = Hops(
    _Path=panel,
    Angle=Slider(120, range=0..1000),
    Height=Slider(4, range=0..10),
    NoOfFloors=Slider(20, range=0..20),
    SpacingBetweenFloor=Slider(1, range=0..1),
    CacheResultsInMemory=True,
    CacheSolveResults=True,
    RemoteDefinitionLocation="https://github.com/nareeiaac/bimsc24_datamgmt_assgn01/raw/main/bimsc24_datamgmt_naree_assignment01.gh",
    RemoteSolveVersion=(0, 1, 0),
    ShowInput_Enabled=False,
    ShowInput_Path=True,
    SynchronousSolve=False)
geometry = Geometry(hops)
